% Simulink data dictionary Driver.sldd

DriverInitialGear = 0
DriverDelayGain = 0.01
DriverYawRateGain = 0.2
DriverAeroRes = 0.5
DriverPositionGainF = 6
DriverPositionGainR = 0.25
DriverPreviewDist = 6
DriverTimeConst = 0.3
DriverDrivelineRes = 75
DriverRollRes = 800
DriverShiftTime = 0.1
DriverTractiveForce = 14000
DriverFrontCornerStiff = 40000
DriverRearCornerStiff = 40000
DriverWheelRange = 1.0472